# Grasshopper definition 180518_Base_HB_Simulation_2.gh (Grasshopper 1.0.5)

honeybee = Honeybee_Honeybee()  # -> Vviiiiiiiiiizzz; plug-in component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
ladybug = Ladybug_Ladybug()  # -> Vviiiiiiiiiizzz; plug-in component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

# ----
# Weather File
panel = Panel("https://www.energyplus.net/weather-download/north_and_central_america_wmo_region_4/CAN/ON/CAN_ON_Toronto.716240_CWEC/all")
epw_stat = Ladybug_OpenEPWAndSTATWeatherFiles(weatherFileURL=panel)  # -> epwFile, statFile; plug-in component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
importepw = Ladybug_ImportEpw(epwFile=epw_stat.epwFile)  # -> readMe, latitude, location, dryBulbTemperature, dewPointTemperature, relativeHumidity, windSpeed, windDirection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; plug-in component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
importstat = Ladybug_ImportStat(statFile=epw_stat.statFile)  # -> readMe, ashraeClimateZone, koppenClimateZone, heatingDesignTemps, coolingDesignTemps, heatingDesignDay, coolingDesignDay, monthlyTauBeam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; plug-in component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

# ----
# Office
geo = Geometry([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])
preview = CustomPreview(Geometry=geo, Material=ColourSwatch(SwatchColor=RGB(30, 0, 255)))
mass2zone = Honeybee_Masses2Zones(zoneMasses=flatten(geo), zoneNames="office", maxRoofAngle=30, createHBZones=Toggle(True))  # -> readMe, HBZones; plug-in component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

# ----
# Laboratory
geo_2 = Geometry([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])
preview_2 = CustomPreview(Geometry=geo_2, Material=ColourSwatch(SwatchColor=RGB(255, 0, 144)))
mass2zone_2 = Honeybee_Masses2Zones(
    zoneMasses=flatten(geo_2),
    zoneNames="laboratory",
    isConditioned=Toggle(True),
    maxRoofAngle=30,
    createHBZones=Toggle(True))  # -> readMe, HBZones; plug-in component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

# ---- group: Analysis_Period
data = Data(importstat.typicalHotWeek)

# ----
toggle = BooleanToggle(True)
# Resolve Boundary
# Conditions
solveadjc = Honeybee_SolveAdjacencies(HBZones=flatten(mass2zone.HBZones), removeCurrentAdjc=False, findAdjc=toggle)  # -> readMe, HBZonesWADJ; plug-in component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
solveadjc_2 = Honeybee_SolveAdjacencies(HBZones=flatten(mass2zone_2.HBZones), removeCurrentAdjc=False, findAdjc=toggle)  # -> readMe, HBZonesWADJ; plug-in component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
panel_2 = Panel("""FanEfficiency
FanPressure
GlareDiscomIndex
HVACSystem
ID
__class__
__delattr__
__dict__
__doc__
__format__
__getattribute__
__hash__
__init__
__module__
__new__
__reduce__
__reduce_ex__
__repr__
__setattr__
__sizeof__
__str__
__subclasshook__
__weakref__
addSrf
assignLoadsBasedOnProgram
assignScheduleBasedOnProgram
atuoPositionDaylightSensor
bldgProgram
ceilingHeight
cenPt
checkZoneNormalsDir
cleanMeshedFaces
cleanName
coolingSetPt
coolingSetPtSchedule
coolingSetback
createZoneFromSurfaces
daylightCntrlFract
decomposeZone
earthtube
equipmentLoadPerArea
equipmentSchedule
fanFlow
floorArea
geometry
getCurrentLoads
getCurrentSchedules
getExposedArea
getFloorArea
getFloorZLevel
getSrfCenPtandNormal
getZoneVolume
glareView
hasInternalEdge
hasNonPlanarSrf
heatingSetPt
heatingSetPtSchedule
heatingSetback
humidityMax
humidityMin
illumCntrlSensorPt
illumSetPt
infiltrationRatePerArea
infiltrationSchedule
insideConvectionAlgorithm
internalMassConstructions
internalMassNames
internalMassSrfAreas
isClosed
isConditioned
isLoadsAssigned
isPlenum
isSchedulesAssigned
isThisTheFirstZone
isThisTheTopZone
joinMesh
lightingDensityPerArea
lightingSchedule
mixAir
mixAirFlowList
mixAirFlowRate
mixAirFlowSched
mixAirZoneList
multiplier
name
natVent
natVentDeltaTemp
natVentMaxIndoorTemp
natVentMaxOutdoorTemp
natVentMinIndoorTemp
natVentMinOutdoorTemp
natVentSchedule
natVentStackDischarge
natVentType
natVentWindDischarge
north
num
numOfPeoplePerArea
objectType
occupancyActivitySch
occupancySchedule
origin
outdoorAirReq
outsideConvectionAlgorithm
partOfArea
prepareNonPlanarZone
recirculatedAirPerArea
resetID
setName
surfaces
transform
updateConstructionSet
ventilationPerArea
ventilationPerPerson
ventilationSched
volume
windowAngle
windowHeightDiff
windowOpeningArea
zoneProgram
zoneType""")
# Constructions
epnomassmat = Honeybee_EnergyPlusNoMassOpaqueMaterial()  # -> EPMaterial; plug-in component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
epopaquemat = Honeybee_EnergyPlusOpaqueMaterial()  # -> EPMaterial; plug-in component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
panel_3 = Panel("""BC
BCObject
EPConstruction
Equals
GetHashCode
GetType
ID
MemberwiseClone
PVgenlist
RadMaterial
ReferenceEquals
ToString
__class__
__delattr__
__dict__
__doc__
__format__
__getattribute__
__hash__
__init__
__module__
__new__
__reduce__
__reduce_ex__
__repr__
__setattr__
__sizeof__
__str__
__subclasshook__
__weakref__
addChildSrf
angle2North
basePlane
calculatePunchedSurface
cenPt
checkForInternalEdge
checkPlanarity
childSrfs
cleanName
cnstrSet
collectMeshFaces
construction
containsPVgen
disposeCurrentMeshes
extractGlzPoints
extractMeshPts
extractPoints
findDiscontinuity
geometry
getAngle2North
getArea
getGlazingArea
getOpaqueArea
getSrfCenPtandNormalAlternate
getTotalArea
getTypeByNormalAngle
getWWR
groundViewFactor
hasChild
hasInternalEdge
intCnstrSet
isAntiClockWise
isChild
isOnGrade
isPlanar
isPossibleChild
isRectangle
isUnderground
meshedFace
name
normalVector
num
numOfVertices
objectType
outdoorBCObject
parent
reEvaluateType
removeAllChildSrfs
resetID
setBC
setBCObject
setBCObjectToOutdoors
setEPConstruction
setName
setRADMaterial
setSunExposure
setType
setWindExposure
shdCntrlZoneInstructs
srfBC
srfBCByUser
srfSunExposure
srfType
srfTypeByUser
srfWindExposure
sunExposure
transform
type
windExposure""")

debrep = DeconstructBrep()  # -> Faces, Edges, Vertices
faceb = FaceBoundaries(Mesh=debrep.Faces)
boundary = BoundarySurfaces(Edges=faceb)
area = Area()  # -> Area, Centroid
python = GhPythonScript(tree=boundary)  # -> popped; inputs tree: tree
# ---------- python: Python ----------
__author__ = "631"
__version__ = "2018.05.23"

import rhinoscriptsyntax as rs

def ghtree2nestlst(tree,nest=True):
    nested_lst = []
    for i in range(tree.BranchCount):
        branchList = tree.Branch(i)
        #change from listobject
        lst = []
        for b in branchList:
            if nest:
                lst.append(b)
            else:
                nested_lst.append(b)
        if nest:
            nested_lst.append(lst)
    return nested_lst

def filter(nlst): return nlst[0] if len(nlst)>0 else None
popped = [filter(nlst) for nlst in ghtree2nestlst(tree)]
# ---------- end python ----------
python_2 = GhPythonScript(srf=flatten(python))  # -> normals; inputs srf: list
# ---------- python_2: Python ----------
__author__ = "631"
__version__ = "2018.05.23"

import rhinoscriptsyntax as rs
import Rhino as rc
from pprint import pprint 
pp = pprint

lensrf = len(srf)
srf = [rs.coercebrep(srf[i]) for i in xrange(lensrf)]

normals = []

for i in xrange(lensrf):
    vrt = list(srf[i].Vertices)
    
    #edg = list(srf[i].Edges)
    #vrt = [edg[0].StartVertex, edg[0].EndVertex, edg[1].StartVertex,edg[1].EndVertex]
    
    lenvrt = len(vrt)
    
    j = 0
    a = rc.Geometry.Point3d(vrt[j].Location)
    b = rc.Geometry.Point3d(vrt[j+1].Location)
    c = rc.Geometry.Point3d(vrt[j+2].Location)
    
    vert1 = rc.Geometry.Vector3d(b-a)
    vert2 = rc.Geometry.Vector3d(c-b)
    
    cp = rc.Geometry.Vector3d.CrossProduct(vert1,vert2)
    
    rc.Geometry.Vector3d.Unitize(cp)
    normals.append(cp)
# ---------- end python_2 ----------
vdisex = VectorDisplayEx(
    Point=flatten(area.Centroid),
    Vector=flatten(python),
    Colour=ColourSwatch(SwatchColor=RGB(255, 0, 0)),
    Width=Slider(3, range=0..10))

epconstruction = Honeybee_EnergyPlusConstruction()  # -> EPConstruction; plug-in component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

# ----
# Surfaces
panel_4 = Panel("outdoor_envelope")
createhbsrfs = Honeybee_createHBSrfs(srfName=panel_4, srfType="0", EPBC="Outdoors", EPConstruction=epconstruction)  # -> readMe, simplify(HBSurface); plug-in component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
glazingcreator = Honeybee_GlazingBasedOnRatio(HBObjects=createhbsrfs.HBSurface, glzRatio=Slider(0.5, range=0..1), breakUpWindow=Toggle(False), runIt=Toggle(True))  # -> readMe, HBObjWGLZ; plug-in component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

# ----
# RADIANCE PARAMETERS
number_slider = Slider(5, range=0..100)
geo_3 = Geometry(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)
gentestpts = Honeybee_GenerateTestPoints(testGeometry=geo_3, gridSize=number_slider, distBaseSrf="0.5", moveTestMesh=True)  # -> readMe, simplify(testPoints), simplify(ptsVectors), simplify(facesArea), simplify(mesh); plug-in component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
gencumsky = Honeybee_GenerateCumulativeSky(weatherFile=epw_stat.epwFile, analysisPeriod=data, generateSky=Toggle(False))  # -> skyFilePath; plug-in component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
geo_4 = Geometry(gentestpts.testPoints)
radparameters = Honeybee_RADParameters(quality=0)  # -> readMe, radParameters; plug-in component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
gridbasedsimulation = Honeybee_GridBasedSimulation(
    skyFile=gencumsky,
    testPoints=gentestpts.testPoints,
    ptsVectors=gentestpts.ptsVectors,
    testMesh=gentestpts.mesh,
    simulationType=Slider(1, range=0..2))  # -> analysisRecipe; plug-in component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

Z = UnitZ(Factor=Slider(22, range=0..100))
move = Move(Motion=Z)  # -> Geometry, Transform
toggle_2 = BooleanToggle(False)

# ---- group: HB_Zones
data_2 = Data([mass2zone_2.HBZones, mass2zone.HBZones])

# ----
preview_3 = CustomPreview(Geometry=move.Geometry, Material=ColourSwatch(SwatchColor=RGB(0, 255, 234)))
gradientlibrary = Ladybug_GradientLibrary(gradIndex=Slider(13, range=0..100))  # -> customColors; plug-in component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
legendpar = Ladybug_LegendParameters(customColors=flatten(gradientlibrary))  # -> legendPar; plug-in component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

# ----
# Service
geo_5 = Geometry([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])
preview_4 = CustomPreview(Geometry=geo_5, Material=ColourSwatch(SwatchColor=RGB(255, 255, 67)))

intersectmass = Honeybee_IntersectMasses(bldgMassesBefore=flatten(geo_5))  # -> bldgMassesAfter; plug-in component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

mass2zone_3 = Honeybee_Masses2Zones(
    zoneMasses=flatten(intersectmass),
    zoneNames="service",
    isConditioned=Toggle(False),
    maxRoofAngle=30,
    createHBZones=Toggle(True))  # -> readMe, HBZones; plug-in component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

askme = Honeybee_AskMe(HBObjects=[mass2zone_2.HBZones, mass2zone_3.HBZones, mass2zone.HBZones])  # -> readMe; plug-in component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
wires = BrepWireframe(Brep=[geo, geo_2, geo_5], Density=-1)
panel_5 = Panel(askme)
preview_5 = CustomPreview(Geometry=wires, Material=ColourSwatch(SwatchColor=RGB(0, 0, 0)))
solveadjc_3 = Honeybee_SolveAdjacencies(HBZones=flatten(mass2zone_3.HBZones), removeCurrentAdjc=False, findAdjc=toggle)  # -> readMe, HBZonesWADJ; plug-in component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
solveadjc_4 = Honeybee_SolveAdjacencies(
    HBZones=flatten([solveadjc.HBZonesWADJ, solveadjc_2.HBZonesWADJ, solveadjc_3.HBZonesWADJ]),
    removeCurrentAdjc=False,
    findAdjc=Toggle(True))  # -> readMe, HBZonesWADJ; plug-in component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
decomposebytype = Honeybee_DecomposeBasedOnType(HBZone=solveadjc_4.HBZonesWADJ)  # -> walls, interiorWalls, airWalls, windows, interiorWindows, skylights, roofs, ceilings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; plug-in component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
# Unzip Surfaces
# by Type
decomposebytype_2 = Honeybee_DecomposeBasedOnType(hbzone=flatten(solveadjc_4.HBZonesWADJ))  # -> exterior_wall_N, exterior_wall_E, exterior_wall_S, exterior_wall_W, interior_wall, ceiling, floor, roof, ground, dbg; plug-in component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
panel_6 = Panel(decomposebytype_2.dbg)
geo_6 = Geometry(decomposebytype_2.exterior_wall_N)
# Zip Surfaces to Zones
python_3 = GhPythonScript(Int=decomposebytype.interiorWalls)
data_3 = Data(python_3)

# ----
# SIMULATION
# P:\890 UTM New Science Building\2. Design\2.5 Research\2.5.6 Simulation\Sensitivity_Analysis_Workflow
panel_7 = Panel("Radiance_UTM")
rundaylightanalysis = Honeybee_RunDaylightSimulation(
    HBObjects=flatten(data_2),
    analysisRecipe=gridbasedsimulation,
    writeRad=toggle_2,
    runRad=toggle_2,
    radFileName=panel_7,
    overwriteResults=True)  # -> readMe, analysisType, resultsUnit, results, testPts, resultFiles, radGeoFile, studyFolder, done; plug-in component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
exporttoopenstudio = Honeybee_ExportToOpenStudio(epwWeatherFile=epw_stat.epwFile, analysisPeriod=data, HBZones=flatten(data_3))  # -> readMe, osmFileAddress, idfFileAddress, resultFileAddress, eioFileAddress, rddFileAddress, htmlReport, studyFolder, model; plug-in component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

recolormesh = Ladybug_RecolorMesh(
    analysisResult=rundaylightanalysis.results,
    inputMesh=gentestpts.mesh,
    analysisTitle=rundaylightanalysis.analysisType,
    legendTitle=rundaylightanalysis.resultsUnit)  # -> readMe, newMesh, newLegend, legendBasePt, meshColors, legendColors; plug-in component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
