# Grasshopper definition gbxml_u_value_test.gh (Grasshopper 1.0.5)

honeybee = Honeybee_Honeybee()  # -> Vviiiiiiiiiizzz; plug-in component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
ladybug = Ladybug_Ladybug()  # -> Vviiiiiiiiiizzz; plug-in component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
path = FilePath("C:\Users\631\Desktop\simple_u_val_example.xml")
updatehoneybee = Honeybee_UpdateHoneybee(updateAllUObjects=Toggle(False))  # -> readMe; plug-in component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
xmltohb = Honeybee_gbXMLToHoneybee(filepath=path, import=Toggle(True))  # -> readMe, model, HBZones, shadings; plug-in component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
panel = Panel(updatehoneybee)
geo = Geometry(xmltohb.HBZones)
item = ListItem(List=geo, Index=0, Wrap=True)
decompose_honeybee_zone = Honeybee_DecomposeHBZone(HBZone=item)  # -> graft(HBSurfaces); plug-in component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
decomposebytype = Honeybee_DecomposeBasedOnType(HBZone=geo)  # -> walls, interiorWalls, airWalls, windows, interiorWindows, skylights, roofs, ceilings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; plug-in component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
bang = ExplodeTree(Data=decompose_honeybee_zone)  # -> _0000, _0001, _0002, _0003, _0004, _0005
wires = BrepWireframe(Brep=geo, Density=-1)
geo_2 = Geometry(bang._0005)
preview = CustomPreview(
    Geometry=[decomposebytype.exposedFloors, decomposebytype.floors, decomposebytype.groundFloors],
    Material=ColourSwatch(SwatchColor=RGB(232, 63, 255)))
preview_2 = CustomPreview(Geometry=decomposebytype.roofs, Material=ColourSwatch(SwatchColor=RGB(0, 255, 61)))
preview_3 = CustomPreview(Geometry=decomposebytype.interiorWalls, Material=ColourSwatch(SwatchColor=RGB(255, 0, 61)))
preview_4 = CustomPreview(
    Geometry=[decomposebytype.undergroundWalls, decomposebytype.undergroundSlabs],
    Material=ColourSwatch(SwatchColor=RGB(181, 103, 61)))
preview_5 = CustomPreview(Geometry=decomposebytype.ceilings, Material=ColourSwatch(SwatchColor=RGB(181, 103, 255)))
askme = Honeybee_AskMe(y=geo_2)  # -> out, name; plug-in component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
panel_2 = Panel(askme.name)
decomposeepconstruction = Honeybee_DecomposeEPConstruction(cnstrName=panel_2)  # -> materials, comments, UValue_SI, UValue_IP, RValue_SI, RValue_IP; plug-in component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
preview_6 = CustomPreview(Geometry=decomposebytype.walls, Material=ColourSwatch(SwatchColor=RGB(255, 255, 255)))
preview_7 = CustomPreview(Geometry=decomposebytype.windows, Material=ColourSwatch(SwatchColor=RGBA(0, 255, 255, 110)))
bang_2 = ExplodeTree(Data=decomposeepconstruction.materials)  # -> _00050, _00051
item_2 = ListItem(List=bang_2._00051, Index="1", Wrap=True)
panel_3 = Panel(decomposeepconstruction.materials)
panel_4 = Panel(decomposeepconstruction.UValue_SI)
panel_5 = Panel(item_2)
decomposeepmaterial = Honeybee_DecomposeEPMaterial(materialName=simplify(panel_5))  # -> names, values, comments, UValue_SI, UValue_IP, RValue_SI, RValue_IP; plug-in component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
panel_6 = Panel(item_2)
panel_7 = Panel(decomposeepmaterial.comments)
multiplication = Multiplication(A=decomposeepmaterial.UValue_SI, B="0.2032")
panel_8 = Panel(decomposeepmaterial.values)
panel_9 = Panel(multiplication)
panel_10 = Panel(decomposeepmaterial.UValue_SI)
