# Grasshopper definition intersect.gh (Grasshopper 1.0.6)
# plug-ins: TT Toolbox

ladybug = Ladybug_Ladybug()  # -> out; plug-in component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
honeybee = Honeybee_Honeybee()  # -> out; plug-in component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
geo = Geometry([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])
geo_2 = Geometry([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])
geo_3 = Geometry([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])
number_slider = Slider(1, range=0..1)
debrep = DeconstructBrep(Brep=geo_3)  # -> Faces, Edges, Vertices
wires = BrepWireframe(Brep=debrep.Faces, Density=-1)
geo_4 = Geometry([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])
brep = Brep([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])
area = Area(Geometry=geo_3)  # -> Area, Centroid
crv = Curve(debrep.Faces)
tbi = TreeBranchIndex(DataTree=crv, BranchIndex=number_slider)
item = ListItem(List=area.Centroid, Index=number_slider, Wrap=True)
intersectmass = Honeybee_IntersectMasses(bldgMassesBefore=flatten(geo_4))  # -> bldgMassesAfter; plug-in component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
python = GhPythonScript(srftree=crv, cptlst=area.Centroid)  # -> flatten(out), intersected, cpts, vec, rvec; inputs srftree: tree, cptlst: list
# ---------- python: Python ----------
import Rhino as rc
import rhinoscriptsyntax as rs
import pprint
import scriptcontext as sc

pp = pprint.pprint

"""
https://github.com/NREL/OpenStudio/search?q=intersect&unscoped_q=intersect
https://github.com/NREL/OpenStudio/blob/7865ba413ef52e8c41b8b95d6643d68eb949f1c4/openstudiocore/sketchup_plugin/openstudio/sketchup_plugin/user_scripts/Alter%20or%20Add%20Model%20Elements/Intersect_Space_Geometry.rb
https://github.com/NREL/OpenStudio/blob/7865ba413ef52e8c41b8b95d6643d68eb949f1c4/openstudiocore/sketchup_plugin/openstudio/sketchup_plugin/sketchup/Geom.rb
"""

def tree_to_list(input, retrieve_base = lambda x: x[0]):
    """Returns a list representation of a Grasshopper DataTree"""
    def extend_at(path, index, simple_input, rest_list):
        target = path[index]
        if len(rest_list) <= target: rest_list.extend([None]*(target-len(rest_list)+1))
        if index == path.Length - 1:
            rest_list[target] = list(simple_input)
        else:
            if rest_list[target] is None: rest_list[target] = []
            extend_at(path, index+1, simple_input, rest_list[target])
    all = []
    for i in range(input.BranchCount):
        path = input.Path(i)
        extend_at(path, 0, input.Branch(path), all)
    return retrieve_base(all)

if sc.sticky.has_key('honeybee_release'):
    if sc.sticky["honeybee_folders"]["OSLibPath"] != None:
        # openstudio is there
        openStudioLibFolder = sc.sticky["honeybee_folders"]["OSLibPath"]
        openStudioIsReady = True

        # check the version of OpenStudio.
        try:
            osVersion = openStudioLibFolder.split('-')[-1].split('/')[0]
        except:
            pass

        import clr
        clr.AddReferenceToFileAndPath(openStudioLibFolder+"\\openStudio.dll")

        import sys
        if openStudioLibFolder not in sys.path:
            sys.path.append(openStudioLibFolder)

        import OpenStudio as ops
    else:
        openStudioIsReady = False
        # let the user know that they need to download OpenStudio libraries
        msg1 = "You do not have OpenStudio installed on Your System.\n" + \
            "You wont be able to use this component until you install it.\n" + \
            "Download the latest OpenStudio for Windows from:\n"
        msg2 = "https://www.openstudio.net/downloads"
        print msg1
        print msg2
        ghenv.Component.AddRuntimeMessage(gh.GH_RuntimeMessageLevel.Warning, msg1)
        ghenv.Component.AddRuntimeMessage(gh.GH_RuntimeMessageLevel.Warning, msg2)
else:
    openStudioIsReady = False


def is_near_zero(val, eps=1e-6):
    return abs(val) < eps


def get_vectors(face, points, brep_vec):
    face_cpt = rc.Geometry.Vector3d(rs.CurveAreaCentroid(face)[0])
    
    vec_A = rc.Geometry.Vector3d(points[1]-points[0])
    vec_B = rc.Geometry.Vector3d(points[2]-points[1])
    
    normal = rc.Geometry.Vector3d.CrossProduct(vec_A, vec_B)
    normal = (face_cpt + normal) - face_cpt
    normal_reverse = (face_cpt + normal) - face_cpt
    normal_reverse.Reverse()
    
    normal_reverse.Unitize()
    normal.Unitize()
    
    return normal, normal_reverse, face_cpt

def get_norm_dist(face,points, brep_vec):
    
    normal, normal_reverse, face_cpt = get_vectors(face, points, brep_vec)
    
    norm_dist = (brep_vec - (face_cpt + normal)).Length
    norm_reverse_dist = (brep_vec - (face_cpt + normal_reverse)).Length
    
    return norm_dist, norm_reverse_dist


def get_norm_vec(face,points, brep_vec):
    
    normal, normal_reverse, face_cpt = get_vectors(face, points, brep_vec)
    
    return face_cpt, normal, normal_reverse

if not openStudioIsReady:
    print "Problem loading OSM"
    
else:
    osm = ops.Model()

    breplst = tree_to_list(srftree)
    
    #breplst = [brep.sort(lambda face: rs.CurveAreaCentroid(face)[0][2]) for brep in breplst]
    
    for i in range(len(breplst)):
        breplst[i] = sorted(breplst[i], key = lambda face: rs.CurveAreaCentroid(face)[0][2])

    for brep in breplst:
        for face in brep:
            z = rs.CurveAreaCentroid(face)[0][2]
            #print 'z: ', z
            points = rs.PolylineVertices(face)
            #for pt in points:
            #    print 'p:', pt
            #print '--'
            
        #print '----'
    
    cpts = []
    vec = []
    rvec = []
    
    # BREP
    srfcount = 0
    for i in range(len(breplst)):
        brep = breplst[i]
        #print 'brep'
        
        osm_space = ops.Space(osm)
        osm_space.setName("space_{}".format(i))

        #surf_vector = ops.SurfaceVector()
        
        # SURFACES
        for j in range(len(brep)):
            face = brep[j]
            points = rs.PolylineVertices(face)
            points.pop(-1)
            
            brep_vec = rs.coerce3dvector(cptlst[i])
            ndist, rndist = get_norm_dist(face, points, brep_vec)
            
            
            if (ndist < rndist):
                points.reverse()
            
            cpt_, n_, nr_ = get_norm_vec(face, points, brep_vec)
            cpts.append(cpt_)
            vec.append(n_*2)
            rvec.append(nr_*2)
            #ndist, rndist = get_norm_dist(face,points, brep_vec)
            
            #print srfcount
            #print ndist
            #print rndist
            #print '--'
            srfcount += 1
            
            #points.reverse()
            
            #print 'chk1', points[0][2], points[1][2], is_near_zero(points[0][2]-points[1][2], 1e-1)
            #if not is_near_zero(points[0][2]-points[1][2], 1e-1):
            #    tmpstart = points.pop(0)
            #    points.append(tmpstart)
            #    #print 'chk2', points[0][2], points[1][2], is_near_zero(points[0][2]-points[1][2], 1e-1)
            
            srf_point_vector = ops.Point3dVector()
            
            
            # POINTS
            for k in range(len(points)):

                pt = points[k]
                #print pt
                ops_pt = ops.Point3d(pt.X, pt.Y, pt.Z)

                srf_point_vector.Add(ops_pt)
            #print '---'
            # Make SURFACE
            osm_srf = ops.Surface(srf_point_vector, osm)
            osm_srf.setName("surface_{}_{}".format(i,j))
            osm_srf.setSpace(osm_space)
            #surf_vector.Add(osm_srf)


    print "Starting spaces", osm.getSpaces().Count
    starting_surfaces = osm.getSurfaces()
    print "Starting # surfaces: ", starting_surfaces.Count

    space_lst = osm.getSpaces()

    #bounding_boxes = []
    #for i in range(space_lst.Count):
    #  bounding_boxes.append(space_lst[i].boundingBox())


    # Intersect Masses
    for i in range(space_lst.Count):
        curr_space = space_lst[i]
        for j in range(space_lst.Count):
            chk_space = space_lst[j]

            # Check if within extents or same sapce
            #if is_near_zero(i-j):
            #    continue
            
            if True==True:#bounding_boxes[i].intersects(bounding_boxes[j]):
                #print 'int exists'
                #try:
                #print [s for s in curr_space.surfaces]
                #print curr_space.surfaces.Count, chk_space.surfaces.Count
                curr_space.intersectSurfaces(chk_space)
                # curr_space.nameString(), chk_space.nameString(),
                #print curr_space.surfaces.Count, chk_space.surfaces.Count
                #print '---'
                #Util.show($"Intersected and matched {sp.nameString()} with {bSpace.nameString()}");
                #except:
                #  print 'fail to intersect'
    #print dir(ops.Model)
    finishing_surfaces = osm.getSurfaces()

    print "Finishing # surfaces: ", finishing_surfaces.Count

    space_lst = osm.getSpaces()
    # Convert back to Rhino
    intersected = []
    for i in range(space_lst.Count):
        surfaces = space_lst[i].surfaces
        for j in range(surfaces.Count):
            osm_points = surfaces[j].vertices()
            rc_points = [rc.Geometry.Point3d(p.x(), p.y(), p.z()) for p in osm_points]
            
            #crv = rc.Geometry.Curve.CreateControlPointCurve(rc_points,1)
            #if not crv.IsClosed:
            rc_points += [rc_points[0]]
            crv = rc.Geometry.Curve.CreateControlPointCurve(rc_points,1)
                #print 'crv added'
                #print "add points"
                
            intersected.append(crv)

            #rc.Geometry.Surface.Create

    #osm.save(ops.Path("intersect.osm"), True)
# ---------- end python ----------
python_2 = GhPythonScript(breps=geo_4)  # -> intersected; inputs breps: list of Brep
# ---------- python_2: Python ----------
import Rhino as rc
import rhinoscriptsyntax as rs
import pprint
import scriptcontext as sc
import ghpythonlib as ghlib

pp = pprint.pprint

"""
https://github.com/NREL/OpenStudio/search?q=intersect&unscoped_q=intersect
https://github.com/NREL/OpenStudio/blob/7865ba413ef52e8c41b8b95d6643d68eb949f1c4/openstudiocore/sketchup_plugin/openstudio/sketchup_plugin/user_scripts/Alter%20or%20Add%20Model%20Elements/Intersect_Space_Geometry.rb
https://github.com/NREL/OpenStudio/blob/7865ba413ef52e8c41b8b95d6643d68eb949f1c4/openstudiocore/sketchup_plugin/openstudio/sketchup_plugin/sketchup/Geom.rb
"""

if sc.sticky.has_key('honeybee_release'):
    if sc.sticky["honeybee_folders"]["OSLibPath"] != None:
        # openstudio is there
        openStudioLibFolder = sc.sticky["honeybee_folders"]["OSLibPath"]
        openStudioIsReady = True

        # check the version of OpenStudio.
        try:
            osVersion = openStudioLibFolder.split('-')[-1].split('/')[0]
        except:
            pass

        import clr
        clr.AddReferenceToFileAndPath(openStudioLibFolder+"\\openStudio.dll")

        import sys
        if openStudioLibFolder not in sys.path:
            sys.path.append(openStudioLibFolder)

        import OpenStudio as ops
    else:
        openStudioIsReady = False
        # let the user know that they need to download OpenStudio libraries
        msg1 = "You do not have OpenStudio installed on Your System.\n" + \
            "You wont be able to use this component until you install it.\n" + \
            "Download the latest OpenStudio for Windows from:\n"
        msg2 = "https://www.openstudio.net/downloads"
        print msg1
        print msg2
        ghenv.Component.AddRuntimeMessage(gh.GH_RuntimeMessageLevel.Warning, msg1)
        ghenv.Component.AddRuntimeMessage(gh.GH_RuntimeMessageLevel.Warning, msg2)
else:
    openStudioIsReady = False


def is_near_zero(val, eps=1e-6):
    return abs(val) < eps


def get_vectors(face, points, brep_vec):
    face_cpt = rc.Geometry.Vector3d(rs.CurveAreaCentroid(face)[0])
    
    vec_A = rc.Geometry.Vector3d(points[1]-points[0])
    vec_B = rc.Geometry.Vector3d(points[2]-points[1])
    
    normal = rc.Geometry.Vector3d.CrossProduct(vec_A, vec_B)
    normal = (face_cpt + normal) - face_cpt
    normal_reverse = (face_cpt + normal) - face_cpt
    normal_reverse.Reverse()
    
    normal_reverse.Unitize()
    normal.Unitize()
    
    return normal, normal_reverse, face_cpt

def get_norm_dist(face,points, brep_vec):
    
    normal, normal_reverse, face_cpt = get_vectors(face, points, brep_vec)
    
    norm_dist = (brep_vec - (face_cpt + normal)).Length
    norm_reverse_dist = (brep_vec - (face_cpt + normal_reverse)).Length
    
    return norm_dist, norm_reverse_dist


def get_norm_vec(face,points, brep_vec):
    
    normal, normal_reverse, face_cpt = get_vectors(face, points, brep_vec)
    
    return face_cpt, normal, normal_reverse

TOL = sc.doc.ModelAbsoluteTolerance

if not openStudioIsReady:
    print "Problem loading OSM. Have you let HB fly?"
    
else:
    osm = ops.Model()
    
    # BREP
    for i in range(len(breps)):
        brep = breps[i]
        
        osm_space = ops.Space(osm)
        osm_space.setName("space_{}".format(i))
        
        # ghlib methods
        faces = ghlib.components.DeconstructBrep(rs.coercebrep(brep))[0]
        brep_vec = rs.coerce3dvector(ghlib.components.Area(brep)[1])
        
        # SURFACES
        for j in range(len(faces)):
            
            face = faces[j]
            
            edges = ghlib.components.DeconstructBrep(face)[1]
            
            face_curve = rc.Geometry.Curve.JoinCurves(edges, TOL)[0]
            nc = face_curve.ToNurbsCurve()
            points = [nc.Points[i_].Location for i_ in xrange(nc.Points.Count)]
            points.pop()
            
            # Sort the face normals of your space
            ndist, rndist = get_norm_dist(face_curve, points, brep_vec)
            
            if (ndist < rndist):
                points.reverse()
            
            srf_point_vector = ops.Point3dVector()
            
            # POINTS
            for k in range(len(points)):

                pt = points[k]
                ops_pt = ops.Point3d(pt.X, pt.Y, pt.Z)
                srf_point_vector.Add(ops_pt)
            
            # Make SURFACE
            osm_srf = ops.Surface(srf_point_vector, osm)
            osm_srf.setName("surface_{}_{}".format(i,j))
            osm_srf.setSpace(osm_space)
            
    
    starting_surfaces = osm.getSurfaces()
 
    space_lst = osm.getSpaces()

    bounding_boxes = []
    for i in range(space_lst.Count):
      bounding_boxes.append(space_lst[i].boundingBox())


    # Intersect Masses
    for i in range(space_lst.Count):
        curr_space = space_lst[i]
        
        for j in range(space_lst.Count):
            chk_space = space_lst[j]

            # Check if within extents or same sapce
            if is_near_zero(i-j):
                continue
            
            if bounding_boxes[i].intersects(bounding_boxes[j]):
                curr_space.intersectSurfaces(chk_space)
                #Util.show($"Intersected and matched {sp.nameString()} with {bSpace.nameString()}");
                
    finishing_surfaces = osm.getSurfaces()
    
    space_lst = osm.getSpaces()
    
    # Convert back to Rhino
    intersected = []
    for i in range(space_lst.Count):
        surfaces = space_lst[i].surfaces
        brep_faces = []
        for j in range(surfaces.Count):
            osm_points = surfaces[j].vertices()
            rc_points = [rc.Geometry.Point3d(p.x(), p.y(), p.z()) for p in osm_points]
            rc_points += [rc_points[0]]
            crv = rc.Geometry.Curve.CreateControlPointCurve(rc_points,1)
            
            face = ghlib.components.BoundarySurfaces(crv)
            brep_faces.append(face)
            
        joined_brep = ghlib.components.BrepJoin(brep_faces)[0]
        intersected.append(joined_brep)
    #osm.save(ops.Path("intersect.osm"), True)
    
    print "{} additional surfaces were added to your {} breps.".format(
        finishing_surfaces.Count - starting_surfaces.Count,
        osm.getSpaces().Count
        )
# ---------- end python_2 ----------
geo_5 = Geometry(python.intersected)
geo_6 = Geometry()
geo_7 = Geometry(python_2)
brep_2 = Brep(intersectmass)
boundary = BoundarySurfaces(Edges=geo_5)
vdisex = VectorDisplayEx(Point=python.cpts, Vector=python.rvec, Colour=ColourSwatch(SwatchColor=RGB(255, 0, 255)), Width=2)
vdisex_2 = VectorDisplayEx(Point=python.cpts, Vector=python.vec, Colour=RGB(0, 0, 0), Width=2)
join = BrepJoin(Breps=boundary)  # -> Breps, Closed
geo_8 = Geometry(join.Breps)
panel = Panel(python.out)
