# Grasshopper definition hb_office.gh (Grasshopper 0.9.76)
# plug-ins: Python Interpreter

updatehoneybee = Honeybee_UpdateHoneybee(updateAllUObjects=Toggle(False))  # -> readMe; plug-in component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
ladybug = Ladybug_Ladybug()  # -> Vviiiiiiiiiizzz; plug-in component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
honeybee = Honeybee_Honeybee()  # -> Vviiiiiiiiiizzz; plug-in component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
xz = XZPlane(Origin=Point(0, 0, 0))
pt = ConstructPoint(XCoordinate="0", YCoordinate="0", ZCoordinate="0")
pt_2 = ConstructPoint(XCoordinate="16", YCoordinate="10", ZCoordinate="3")
bldgprograms = Honeybee_bldgPrograms({"Office": 0, "Retail": 1, "MidriseApartment": 2, "PrimarySchool": 3, "SecondarySchool": 4, "SmallHotel": 5, "LargeHotel": 6, "Hospital": 7, "Outpatient": 8, "Warehouse": 9, "SuperMarket": 10, "FullServiceRestaurant": 11, "QuickServiceRestaurant": 12}, selected="Office")
box = Box2Pt(PointA=pt, PointB=pt_2, Plane=xz)
split2zone = Honeybee_SplitFloor2ThermalZones(bldgFloors=flatten(box), perimeterZoneDepth="2", runIt=Toggle(True))  # -> readMe, splitBldgZones; plug-in component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
listzoneprograms = Honeybee_ListZonePrograms(bldgProgram=bldgprograms)  # -> OfficeZonePrograms; plug-in component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
item = ListItem(List=listzoneprograms, Index="4", Wrap=True)
toggle = BooleanToggle(True)
panel = Panel(listzoneprograms)
mass2zone = Honeybee_Masses2Zones(
    zoneMasses=flatten(split2zone.splitBldgZones),
    zonePrograms=item,
    isConditioned=toggle,
    maxRoofAngle=30,
    createHBZones=toggle)  # -> readMe, HBZones; plug-in component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
solveadjc = Honeybee_SolveAdjacencies(HBZones=flatten(mass2zone.HBZones), removeCurrentAdjc=False, findAdjc=toggle)  # -> readMe, HBZonesWADJ; plug-in component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
panel_2 = Panel("https://energyplus.net/weather-download/north_and_central_america_wmo_region_4/CAN/ON/CAN_ON_Toronto.716240_CWEC/all")
toggle_2 = BooleanToggle(True)
epw_stat = Ladybug_OpenEPWAndSTATWeatherFiles(weatherFileURL=panel_2)  # -> epwFile, statFile; plug-in component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
glazingcreator = Honeybee_GlazingBasedOnRatio(HBObjects=solveadjc.HBZonesWADJ, glzRatio=Slider(0.3, range=0..1), breakUpWindow=Toggle(False), runIt=Toggle(True))  # -> readMe, HBObjWGLZ; plug-in component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
epoutput = Honeybee_GenerateEPOutput(
    zoneGainsAndLosses=toggle_2,
    zoneComfortMetrics="False",
    surfaceTempAnalysis=toggle_2,
    surfaceEnergyAnalysis=toggle_2,
    glazingSolarAnalysis=toggle_2)  # -> report, flatten(simulationOutputs); plug-in component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
toggle_3 = BooleanToggle(True)
geo = Geometry(glazingcreator.HBObjWGLZ)
exporttoopenstudio = Honeybee_ExportToOpenStudio(
    epwWeatherFile=epw_stat.epwFile,
    HBZones=flatten(glazingcreator.HBObjWGLZ),
    simulationOutputs=flatten(epoutput.simulationOutputs),
    writeOSM=toggle_3,
    runSimulation=toggle_3,
    fileName="hb_office")  # -> readMe, osmFileAddress, idfFileAddress, resultFileAddress, eioFileAddress, rddFileAddress, htmlReport, studyFolder, model; plug-in component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
fileexplorer = Honeybee_OpenFileDirectory(filePath=exporttoopenstudio.osmFileAddress)  # -> ReadMe; plug-in component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
